# Grasshopper definition test.gh (Grasshopper 1.0.7)

# ---- group: RH_IN:x
x_position = Slider(71, range=1..150)

# ---- group: RH_IN:y
y_position = Slider(60, range=1..210)

# ----
mesh = Mesh(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)
curve = Curve([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])
x_position_2 = GetNumber(x_position, AtLeast=1, AtMost=2147483647, Maximum=1.797693135e+308, Minimum=-1.797693135e+308)
panel = Panel("""TRUE
FALSE
FALSE""")
construct_point = ConstructPoint(XCoordinate=x_position_2, YCoordinate=y_position, ZCoordinate=0)
unit_z = UnitZ(Factor=1)
cull_pattern = CullPattern(List=curve, CullPattern=invert(panel))
cull_pattern_2 = CullPattern(List=curve, CullPattern=panel)
project_point = ProjectPoint(Point=construct_point, Direction=unit_z, Geometry=mesh)  # -> Point, Index
dash_pattern = DashPattern(Curve=cull_pattern_2, Pattern=Slider(1.9, range=0.1..5))  # -> Dashes, Gaps
curve_2 = Curve(cull_pattern)
mesh_sphere_ex = MeshSphereEx(Base=project_point.Point, Radius=10, Count=5)
mesh_colours = MeshColours(Mesh=mesh_sphere_ex, Colours=ColourSwatch(SwatchColor=RGB(255, 125, 125)))
mesh_colours_2 = MeshColours(Mesh=mesh, Colours=ColourSwatch(SwatchColor=RGB(255, 212, 212)))

# ---- group: RH_OUT:curve
curve_3 = Curve([dash_pattern.Dashes, curve_2])

# ---- group: RH_OUT:mesh
mesh_2 = Mesh([mesh_colours, mesh_colours_2])
